% Simulink data dictionary VCU10DB.sldd

apps1 = Simulink.Signal(StorageClass="ExportedGlobal", DataType="uint16")
apps2 = Simulink.Signal(StorageClass="ExportedGlobal", DataType="uint16")
brkps = Simulink.Signal(StorageClass="ExportedGlobal", DataType="uint16")
wlspd_fsensor = Simulink.Signal(StorageClass="ExportedGlobal", DataType="single")
wlspd_hsensor = Simulink.Signal(StorageClass="ExportedGlobal", DataType="single")
oilprs_frsensor = Simulink.Signal(StorageClass="ExportedGlobal", DataType="uint16")
oilprs_rrsensor = Simulink.Signal(StorageClass="ExportedGlobal", DataType="uint16")
oilprs_flsensor = Simulink.Signal(StorageClass="ExportedGlobal", DataType="uint16")
oilprs_rlsensor = Simulink.Signal(StorageClass="ExportedGlobal", DataType="uint16")
airprs_sensor1 = Simulink.Signal(StorageClass="ExportedGlobal", DataType="uint16")
airprs_sensor2 = Simulink.Signal(StorageClass="ExportedGlobal", DataType="uint16")
ebs_drivercheck = Simulink.Signal(StorageClass="ExportedGlobal", DataType="boolean")
ebs_trig = Simulink.Signal(StorageClass="ExportedGlobal", DataType="boolean")
ebs_watchdog = Simulink.Signal(StorageClass="ExportedGlobal", DataType="boolean")
ESP_T_01 = Simulink.Signal(StorageClass="ExportedGlobal", DataType="uint8", Dimensions=[1 8])
ESP_T_03 = Simulink.Signal(StorageClass="ExportedGlobal", DataType="uint8", Dimensions=[1 8])
ESP_T_06 = Simulink.Signal(StorageClass="ExportedGlobal", DataType="uint8", Dimensions=[1 8])
ESP_T_07 = Simulink.Signal(StorageClass="ExportedGlobal", DataType="uint8", Dimensions=[1 8])
ESP_R_00 = Simulink.Signal(StorageClass="ExportedGlobal", DataType="uint8", Dimensions=[1 8])
canb_epssendmsg1 = Simulink.Signal(StorageClass="ExportedGlobal", DataType="uint8", Dimensions=[1 8])
canb_epssendmsg2 = Simulink.Signal(StorageClass="ExportedGlobal", DataType="uint8", Dimensions=[1 8])
canb_epsmsg = Simulink.Signal(StorageClass="ExportedGlobal", DataType="uint8", Dimensions=[1 8])
bms_error = Simulink.Signal(StorageClass="ExportedGlobal", DataType="boolean")
imd_error = Simulink.Signal(StorageClass="ExportedGlobal", DataType="boolean")
led_brake = Simulink.Signal(StorageClass="ExportedGlobal", DataType="boolean")
led_assi_blue = Simulink.Signal(StorageClass="ExportedGlobal", DataType="boolean")
led_assi_yellow = Simulink.Signal(StorageClass="ExportedGlobal", DataType="boolean")
led_ebs_error = Simulink.Signal(StorageClass="ExportedGlobal", DataType="boolean")
run_button = Simulink.Signal(StorageClass="ExportedGlobal", DataType="boolean")
tsms_button = Simulink.Signal(StorageClass="ExportedGlobal", DataType="boolean")
ami_acceleration = Simulink.Signal(StorageClass="ExportedGlobal", DataType="boolean")
ami_skidpad = Simulink.Signal(StorageClass="ExportedGlobal", DataType="boolean")
ami_trackdriver = Simulink.Signal(StorageClass="ExportedGlobal", DataType="boolean")
ami_ebstest = Simulink.Signal(StorageClass="ExportedGlobal", DataType="boolean")
ami_inspection = Simulink.Signal(StorageClass="ExportedGlobal", DataType="boolean")
r2d_buzzer = Simulink.Signal(StorageClass="ExportedGlobal", DataType="boolean")
ebs_buzzer = Simulink.Signal(StorageClass="ExportedGlobal", DataType="boolean")
asms_button = Simulink.Signal(StorageClass="ExportedGlobal", DataType="boolean")
ami_manualdriving = Simulink.Signal(StorageClass="ExportedGlobal", DataType="boolean")
res_msg = Simulink.Signal(StorageClass="ExportedGlobal", DataType="uint8", Dimensions=[1 8])
canb_ipctsmsg1 = Simulink.Signal(StorageClass="ExportedGlobal", DataType="uint8", Dimensions=[1 8])
canb_ipctsmsg2 = Simulink.Signal(StorageClass="ExportedGlobal", DataType="uint8", Dimensions=[1 8])
canb_ipcrxmsg = Simulink.Signal(StorageClass="ExportedGlobal", DataType="uint8", Dimensions=[1 8])
led_imd_error = Simulink.Signal(StorageClass="ExportedGlobal", DataType="boolean")
led_bms_error = Simulink.Signal(StorageClass="ExportedGlobal", DataType="boolean")
F = Simulink.Parameter(0, StorageClass="Define", DataType="boolean")
T = Simulink.Parameter(1, StorageClass="Define", DataType="boolean")
di8_out = Simulink.Signal(StorageClass="ExportedGlobal", DataType="boolean")
AMI_Tx = Simulink.Signal(StorageClass="ExportedGlobal", DataType="uint8", Dimensions=[1 8])
AMI_Rx = Simulink.Signal(StorageClass="ExportedGlobal", DataType="uint8", Dimensions=[1 8])
di8 = Simulink.Signal(StorageClass="ExportedGlobal", DataType="boolean")
run = Simulink.Signal(StorageClass="ExportedGlobal", DataType="boolean")
ts_buzzer = Simulink.Signal(StorageClass="ExportedGlobal", DataType="boolean")
res_error = Simulink.Signal(StorageClass="ExportedGlobal", DataType="boolean")
digital_low_output = Simulink.Signal(StorageClass="ExportedGlobal", DataType="uint8")
di8_in = Simulink.Signal(StorageClass="ExportedGlobal", DataType="boolean")
di8_flag = Simulink.Signal(StorageClass="ExportedGlobal", DataType="boolean", InitialValue="0")
digital_high_output = Simulink.Signal(StorageClass="ExportedGlobal", DataType="uint8")
digital_input = Simulink.Signal(StorageClass="ExportedGlobal", DataType="uint16")
model_hin = Simulink.Signal(StorageClass="ExportedGlobal", DataType="uint16")
model_ain = Simulink.Signal(StorageClass="ExportedGlobal", DataType="uint16", Dimensions=[1 5])
cana_motor_cmd = Simulink.Signal(StorageClass="ExportedGlobal", DataType="uint8", Dimensions=[1 8])
cana_motor_cmd3 = Simulink.Signal(StorageClass="ExportedGlobal", DataType="uint8", Dimensions=[1 8])
airprs1 = Simulink.Signal(StorageClass="ExportedGlobal", DataType="uint16")
airprs2 = Simulink.Signal(StorageClass="ExportedGlobal", DataType="uint16")
ebs_driver_check = Simulink.Signal(StorageClass="ExportedGlobal", DataType="boolean")
shutdown_s = Simulink.Signal(StorageClass="ExportedGlobal", DataType="boolean")
shutdown_e = Simulink.Signal(StorageClass="ExportedGlobal", DataType="boolean")
di8_cockpit = Simulink.Signal(StorageClass="ExportedGlobal", DataType="boolean")
di8_side = Simulink.Signal(StorageClass="ExportedGlobal", DataType="boolean")
tsms = Simulink.Signal(StorageClass="ExportedGlobal", DataType="boolean")
asms = Simulink.Signal(StorageClass="ExportedGlobal", DataType="boolean")
vcu_dbg_control = Simulink.Signal(StorageClass="ExportedGlobal", DataType="uint8", Dimensions=8)
vcu_dbg_pedal_adc = Simulink.Signal(StorageClass="ExportedGlobal", DataType="uint8", Dimensions=8)
vcu_dbg_air_wheel = Simulink.Signal(StorageClass="ExportedGlobal", DataType="uint8", Dimensions=8)
vcu_dbg_digital = Simulink.Signal(StorageClass="ExportedGlobal", DataType="uint8", Dimensions=8)
vcu_dbg_rx_count = Simulink.Signal(StorageClass="ExportedGlobal", DataType="uint8", Dimensions=4)
model_lox = Simulink.Signal(DataType="fixdt(0,7,0)")
model_hox = Simulink.Signal(DataType="uint8")
FSEC_ESP_EMERGENCY_PRESSURE_MPA = Simulink.Parameter(8, DataType="double", Unit="MPa")  % AS Emergency 时 ESP 四轮冗余制动压力；实车制动标定后复核。